# Grasshopper definition lamp.gh (Grasshopper 0.9.76)
# plug-ins: Kangaroo Components, LunchBox, Weaverbird, MeshDual, Starling

number_slider = Slider(2, range=0..10)
number_slider_2 = Slider(2.5, range=0..10)
# Schwarz P-Primitive relaxed by Kangaroo springs
# FA ČVUT, CAD3 - Scripting, Šimon Prokop, 2014_11_21
mesh = Mesh(<mesh referenced from the Rhino model>)  # disabled
pt = Point([<point referenced from the Rhino model> x4])  # disabled
mesh_2 = Mesh(<mesh referenced from the Rhino model>)
number_slider_3 = Slider(-9.732, range=-10..10)  # disabled
wbnaked = WeaverbirdsNakedBoundary(MeshClosedPolylines=mesh_2)
wbedges = WeaverbirdsMeshEdges(MeshOrPolylines=mesh_2)
wbvertices = WeaverbirdsVerticesComponent(MeshClosedPolylinesGroup=mesh, Weld=True)  # disabled
wbedges_2 = WeaverbirdsMeshEdges(MeshOrPolylines=mesh)  # disabled
box = CenterBox(Base=PlaneXY(0, 0, 0), X=number_slider, Y=number_slider, Z=number_slider)
len = Length(Curve=wbedges)
explode = Explode(Curve=wbnaked, Recursive=True)  # -> Segments, Vertices
len_2 = Length(Curve=wbedges_2)  # disabled
Z = UnitZ(Factor=expr("-x", number_slider_3))  # disabled
bnd = Bounds(Numbers=len)
debrep = DeconstructBrep(Brep=box)  # -> Faces, Edges, Vertices
list_item = ListItem(List=debrep.Faces, Index=0, Wrap=True)  # -> Item, Item1, Item2, Item3, Item4, Item5
subtraction = Subtraction(A=len, B=Slider(1.69, range=0..10))
viewer = ParamViewer(explode.Vertices)
panel = Panel("0")
pt_2 = Point(flatten(explode.Vertices))
springs = SpringsFromLine(Connection=wbedges_2, Stiffness=1000, Damping=10, RestLength=len_2, UpperCutoff=0, LowerCutoff=0, Plasticity=0)  # disabled
surface = Surface(list_item.Item4)
panel_2 = Panel(bnd)
uforce = UnaryForce(Point=wbvertices, Force=Z)  # disabled
item = ListItem(List=debrep.Faces, Index=0, Wrap=True)
planar = IsPlanar(Surface=item, Interior=True)  # -> Planar, Plane
deplane = DeconstructPlane(Plane=planar.Plane)  # -> Origin, XAxis, YAxis, ZAxis
planar_2 = IsPlanar(Surface=debrep.Faces, Interior=True)  # -> Planar, Plane
springs_2 = SpringsFromLine(
    Connection=wbedges,
    Stiffness=1000,
    Damping=10,
    RestLength=Slider(0.29, range=0..10),
    UpperCutoff=0,
    LowerCutoff=0,
    Plasticity=0)
toggle = BooleanToggle(False)  # disabled
reverse = Reverse(Vector=deplane.ZAxis)
cir = Circle(Plane=planar.Plane, Radius=number_slider_2)
list_item_2 = ListItem(List=planar_2.Plane, Index=0, Wrap=True)  # -> Item, Item1, Item2, Item3, Item4, Item5
multiplication = Multiplication(A=reverse, B=Slider(1.4, range=0..10))
edges = BrepEdges(Brep=item)  # -> Naked, Interior, NonManifold
kangaroo = KangarooPhysics(ForceObjects=flatten([uforce, springs]), AnchorPoints=pt, Settings=null, Geometry=mesh, SimulationReset=toggle)  # -> Out, Iterations, ParticlesOut, GeometryOut, KE; disabled
timer = Timer(TimerInterval=50, Target=kangaroo)  # disabled
kangaroo_2 = KangarooPhysics(ForceObjects=flatten(springs_2), AnchorPoints=pt_2, Settings=null, Geometry=mesh_2, SimulationReset=Toggle(False))  # -> Out, Iterations, ParticlesOut, GeometryOut, KE
join = JoinCurves(Curves=edges.Naked, Preserve=False)  # -> flatten(Curves)
timer_2 = Timer(TimerInterval=50, Target=kangaroo_2)  # disabled
geometry = Geometry(list_item_2.Item2)
geometry_2 = Geometry(list_item_2.Item)
geometry_3 = Geometry(list_item_2.Item1)
geometry_4 = Geometry(list_item_2.Item3)
geometry_5 = Geometry([list_item_2.Item4, list_item_2.Item5])
number_slider_4 = Slider(1, range=0..100)
pi = Pi(Factor="-1/4")
merge = Merge(Data1=geometry, Data2=geometry_2, Data3=geometry_3, Data4=geometry_4)
flip = FlipCurve(Curve=join)  # -> Curve, Flag
move = Move(Geometry=flip.Curve, Motion=multiplication)  # -> flatten(Geometry), Transform
fillet = Fillet(Curve=move.Geometry, Radius=number_slider_4)
area = Area(Geometry=fillet)  # -> Area, Centroid
mesh_3 = Mesh(kangaroo.GeometryOut)  # disabled
mesh_4 = Mesh(kangaroo_2.GeometryOut)
scale = Scale(Geometry=fillet, Center=area.Centroid, Factor=Slider(0.8, range=0..1))  # -> Geometry, Transform
loft = Loft(
    Curves=[flip.Curve, scale.Geometry],
    Options={Adjust=True, Closed=False, LoftEnds=0, LoftSimp=0, LoftType=5, Rebuild=10, Refit=0.01})
custom_mesh_settings = SettingsCustom(
    StitchSeams=True,
    SimplePlanes=True,
    Refine=True,
    MinCount=16,
    MaxCount=400,
    AspectRatio=20,
    MaxDistance=0,
    MaxAngle=20,
    MinEdge=0,
    MaxEdge=0)
weaverbird_s_loop_subdivision = WeaverbirdsLoopSubdivision(Level=1, SmoothNakedEdges=1)
timer_3 = Timer(TimerInterval=100, Target=kangaroo_3)
number_slider_5 = Slider(8, range=0..9)  # disabled
number_slider_6 = Slider(2, range=0..10)  # disabled
number_slider_7 = Slider(0.02, range=0..1)  # disabled
swatch = ColourSwatch(SwatchColor=RGB(209, 137, 69))  # disabled
toggle_2 = BooleanToggle(True)  # disabled
swatch_2 = ColourSwatch(SwatchColor=RGB(240, 204, 86))  # disabled
preview = CustomPreview(Shader={ambient=RGB(0, 0, 0), diffuse=RGB(255, 105, 180), emission=RGB(76, 32, 54), shine=0.5, specular=RGB(255, 255, 255), transparency=0})  # disabled

planar_3 = IsPlanar(Surface=item, Interior=True)  # -> Planar, Plane
deplane_2 = DeconstructPlane(Plane=planar_3.Plane)  # -> Origin, XAxis, YAxis, ZAxis
cir_2 = Circle(Plane=planar_3.Plane, Radius=number_slider_2)
edges_2 = BrepEdges(Brep=item)  # -> Naked, Interior, NonManifold
multiplication_2 = Multiplication(A=deplane_2.ZAxis, B=Slider(6.1, range=0..10))
join_2 = JoinCurves(Curves=edges_2.Naked, Preserve=False)  # -> flatten(Curves)
pi_2 = Pi(Factor="-1/4")
flip_2 = FlipCurve(Curve=join_2)  # -> Curve, Flag
move_2 = Move(Geometry=flip_2.Curve, Motion=multiplication_2)  # -> flatten(Geometry), Transform
curvepoint = PointOnCurve(flip_2.Curve, parameter=0)

area_2 = Area(Geometry=move_2.Geometry)  # -> Area, Centroid
scale_nu = ScaleNU(
    Geometry=move_2.Geometry,
    Plane=area_2.Centroid,
    ScaleX=Slider(1.6, range=0..10),
    ScaleY=1,
    ScaleZ=Slider(1.2, range=0..10))  # -> Geometry, Transform
fillet_2 = Fillet(Curve=scale_nu.Geometry, Radius=number_slider_4)
area_3 = Area(Geometry=fillet_2)  # -> Area, Centroid
scale_2 = Scale(Geometry=fillet_2, Center=area_3.Centroid, Factor=Slider(0.8, range=0..1))  # -> Geometry, Transform
orient = Orient(Geometry=loft, Source=planar_3.Plane, Target=geometry_5)  # -> Geometry, Transform
loft_2 = Loft(
    Curves=[scale_2.Geometry, flip_2.Curve],
    Options={Adjust=True, Closed=False, LoftEnds=0, LoftSimp=0, LoftType=5, Rebuild=10, Refit=0.01})
orient_2 = Orient(Geometry=loft_2, Source=planar_3.Plane, Target=merge)  # -> Geometry, Transform
merge_2 = Merge(Data1=orient_2.Geometry, Data2=orient.Geometry)
join_3 = BrepJoin(Breps=merge_2)  # -> Breps, Closed
mesh_5 = MeshBrep(Brep=join_3.Breps, Settings=custom_mesh_settings)
combine_clean = CombineClean(Meshes=mesh_5)
wbedges_3 = WeaverbirdsMeshEdges(MeshOrPolylines=combine_clean)
len_3 = Length(Curve=wbedges_3)
wbnaked_2 = WeaverbirdsNakedBoundary(MeshClosedPolylines=mesh_5)
explode_2 = Explode(Curve=wbnaked_2, Recursive=True)  # -> Segments, flatten(Vertices)
division = Division(A=len_3, B="30")
panel_3 = Panel(mesh_5)
subtraction_2 = Subtraction(A=len_3, B=Slider(1.373, range=0..10))
springs_3 = SpringsFromLine(
    Connection=wbedges_3,
    Stiffness=Slider(10, range=0..10000),
    Damping=10,
    RestLength=division,
    UpperCutoff=0,
    LowerCutoff=0,
    Plasticity=0)
kangaroo_3 = KangarooPhysics(
    ForceObjects=flatten(springs_3),
    AnchorPoints=explode_2.Vertices,
    Settings=null,
    Geometry=mesh_5,
    SimulationReset=Toggle(True))  # -> Out, Iterations, ParticlesOut, GeometryOut, KE
mesh_6 = Mesh(kangaroo_3.GeometryOut)
clean = CombineClean(Meshes=mesh_6)  # disabled
wbloop = WeaverbirdsLoopSubdivision(MeshCurves=clean, Level=1, SmoothNakedEdges=1)  # disabled
meshdual = MeshDual(Mesh=wbloop, Center=Slider(1, range=0..10))  # disabled
crv = Curve(meshdual)  # disabled
len_4 = Length(Curve=crv)  # -> simplify(Length); disabled
slstarmesh = SlStarMesh(Polyline=crv)  # disabled
wbedges_4 = WeaverbirdsMeshEdges(MeshOrPolylines=mesh_6)
area_4 = Area(Geometry=slstarmesh)  # -> Area, Centroid; disabled
wbnaked_3 = WeaverbirdsNakedBoundary(MeshClosedPolylines=wbloop)  # -> graft(NakedCurves); disabled
panel_4 = Panel(len_4)  # disabled
mjoin = MeshJoin(Meshes=slstarmesh)  # disabled
cp = ControlPoints(Curve=wbnaked_3)  # -> Points, Weights, Knots; disabled
wbnaked_4 = WeaverbirdsNakedBoundary(MeshClosedPolylines=mjoin)  # -> graft(NakedCurves); disabled
intcrv = Interpolate(Vertices=cp.Points, Degree=3, Periodic=False, KnotStyle=1)  # -> Curve, Length, Domain; disabled
cp_2 = ControlPoints(Curve=wbnaked_4)  # -> flatten(Points), Weights, Knots; disabled
larger = LargerThan(FirstNumber=len_4, SecondNumber=number_slider_5)  # -> LargerThan, OrEqualTo; disabled
loft_3 = Loft(
    Curves=[intcrv.Curve, wbnaked_4],
    Options={Adjust=False, Closed=False, LoftEnds=0, LoftSimp=0, LoftType=0, Rebuild=10, Refit=0.01})  # disabled
panel_5 = Panel(intcrv.Curve)  # disabled
cp_3 = ClosestPoint(Point=cp_2.Points, Cloud=area_4.Centroid)  # -> ClosestPoint, CPIndex, Distance; disabled
cp_4 = ClosestPoint(Point=area_4.Centroid, Cloud=cp_2.Points)  # -> ClosestPoint, CPIndex, Distance; disabled
dispatch = Dispatch(List=crv, DispatchPattern=larger.OrEqualTo)  # -> ListA, ListB; disabled
remove_dupvalues = VBScript(Values=cp_3.CPIndex)  # -> out, A; inputs Values: list; disabled
# ---------- remove_dupvalues: VB ----------
    'Here's the cool trick, we need to test for each value whether or not we already
    'added it to the list. For a big list of numbers that involves a lot of iteration.
    'We can use a SortedDictionary to keep track of alreade added numbers, 
    'while maintaining a very low lookup ratio.
    
    'lut stands for LookUpTable. Ignore the Boolean, 
    'we have to specify *something* for the second argument
    Dim lut As New SortedDictionary(Of Double, Boolean)
    
    'This list will be the one we return
    Dim result As New List(Of Double)
    
    'Iterate over all numbers in Values
    For Each value As Double In Values
      'Test the lookup table to see if value is already defined
      If (lut.ContainsKey(value)) Then Continue For
      
      'If not, add the value both to the return list AND the table.
      result.Add(value)
      lut.Add(value, True) 'Ignore the True, we just have to specify *some* boolean.
    Next

    A = result
# ---------- end remove_dupvalues ----------
split = SplitList(List=slstarmesh, Index=remove_dupvalues.A)  # -> ListA, ListB; disabled
item_2 = ListItem(List=slstarmesh, Index=remove_dupvalues.A, Wrap=True)  # disabled
crv_2 = Curve(dispatch.ListA)  # disabled
crv_3 = Curve(dispatch.ListB)  # disabled
panel_6 = Panel(remove_dupvalues.A)  # disabled
slstarmesh_2 = SlStarMesh(Polyline=crv_3)  # disabled
slstarmesh_3 = SlStarMesh(Polyline=crv_2)  # disabled
clean_2 = CombineClean(Meshes=slstarmesh_3)  # disabled
wbframe = WeaverbirdsPictureFrame(MeshPolylines=clean_2, Distance=number_slider_6, InsetType=0)  # disabled
clean_3 = CombineClean(Meshes=[item_2, slstarmesh_2])  # disabled
clean_4 = CombineClean(Meshes=flatten([slstarmesh_2, wbframe, item_2]))  # disabled
wbthicken = WeaverbirdsMeshThicken(MeshCurves=wbframe, Distance=number_slider_7, OffsetType=0)  # disabled
wbthicken_2 = WeaverbirdsMeshThicken(MeshCurves=clean_3, Distance=number_slider_7, OffsetType=0)  # disabled
wbthicken_3 = WeaverbirdsMeshThicken(MeshCurves=clean_4, Distance=number_slider_7, OffsetType=0)  # disabled
bake = ObjectBake(
    BakeToggle=toggle_2,
    GeometryObjects=wbthicken_3,
    Layer="GH_Bake",
    ObjectName="GH_Obj",
    ObjectColor=RGB(255, 255, 255),
    LayerColor=RGB(255, 255, 255))  # disabled
preview_2 = CustomPreview(Geometry=wbthicken, Shader=swatch)  # disabled
preview_3 = CustomPreview(Geometry=wbthicken_2, Shader=swatch_2)  # disabled

curvepoint_2 = PointOnCurve(scale_2.Geometry, parameter=0.054)

line = Line(StartPoint=curvepoint_2, EndPoint=curvepoint)

swp2 = Sweep2(Rail1=scale_2.Geometry, Rail2=flip_2.Curve, Sections=line, SameHeight=False)
